# Grasshopper definition enclosure_generation.gh (Grasshopper 1.0.8)
# plug-ins: Pufferfish, PTComponentLibrary, Wombat

# ---- group: potentiometers knockout
z_low = Panel("-20.0")
z_high = Panel("-9.0")
construct_point = ConstructPoint(XCoordinate="46.5", YCoordinate="10.0", ZCoordinate=z_low)
construct_point_2 = ConstructPoint(XCoordinate="19.0", YCoordinate="-10", ZCoordinate=z_high)
box_2pt = Box2Pt(PointA=construct_point_2, PointB=construct_point, Plane=PlaneXY(0, 0, 0))

# ---- group: Button Hole
xz_plane = XZPlane(Origin=Point(0, 0, 0))
button_diameter = Panel("7.5")
circle = Circle(Plane=xz_plane, Radius=expr("x/2", button_diameter))
unit_y = UnitY(Factor="30.0")
patch = Patch(Curves=circle, Spans=20, Flexibility=1, Trim=True)
extrude = Extrude(Base=patch, Direction=unit_y)
move = Move(Geometry=extrude, Motion="40, 40, -15")  # -> Geometry, Transform

# ---- group: Antenna Hole
xz_plane_2 = XZPlane(Origin=Point(0, 0, 0))
antenna_diameter = Panel("2.0")
circle_2 = Circle(Plane=xz_plane_2, Radius=expr("x/2", antenna_diameter))
unit_y_2 = UnitY(Factor="30.0")
patch_2 = Patch(Curves=circle_2, Spans=20, Flexibility=1, Trim=True)
extrude_2 = Extrude(Base=patch_2, Direction=unit_y_2)
move_2 = Move(Geometry=extrude_2, Motion="30, 40, -15")  # -> Geometry, Transform; disabled

# ---- group: Speaker
face_speaker_diameter = Panel("28.5")
xy_plane = XYPlane(Origin=Point(0, 0, 0))
translation_vector = Panel("0, 0, 0")
full_thickness = Panel("7.5")
rear_speaker_diameter = Panel("17.0")
step_thickness = Panel("4.5")
vector = Vector(translation_vector)
move_3 = Move(Geometry=xy_plane, Motion=vector)  # -> Geometry, Transform
circle_3 = Circle(Plane=move_3.Geometry, Radius=expr("x/2", face_speaker_diameter))
circle_4 = Circle(Plane=move_3.Geometry, Radius=expr("x/2", face_speaker_diameter))
circle_5 = Circle(Plane=move_3.Geometry, Radius=expr("x/2", rear_speaker_diameter))
negative = Negative(Value=step_thickness)
negative_2 = Negative(Value=full_thickness)
unit_z = UnitZ(Factor=negative)
unit_z_2 = UnitZ(Factor=negative_2)
loft_options = LoftOptions(Closed=False, Adjust=False, Rebuild=0, Refit=0, Type=3)
move_4 = Move(Geometry=circle_4, Motion=unit_z)  # -> Geometry, Transform
move_5 = Move(Geometry=circle_5, Motion=unit_z_2)  # -> Geometry, Transform
loft = Loft(Curves=[circle_3, move_4.Geometry, move_5.Geometry], Options=loft_options)
cap_holes = CapHoles(Brep=loft)
yz_plane = YZPlane(Origin=Point(0, 0, 0))
rotate = Rotate(Angle=degrees("90"), Plane=yz_plane)  # -> Geometry, Transform
move_6 = Move(Motion="50, 0, 20")  # -> Geometry, Transform
compound = Compound(Transforms=[rotate.Transform, move_6.Transform])
transform = Transform(Geometry=cap_holes, Transform=compound)
patch_3 = Patch(Curves=circle_3, Spans=20, Flexibility=1, Trim=True)
speaker_placement_transform = Transform(compound)
speaker_body = Brep(transform)
face_speaker_surface = Surface(patch_3)

# ----
# Barrel Jack Hole
yz_plane_2 = YZPlane(Origin=Point(0, 0, 0))
barrel_jack_diameter = Panel("12.0")
circle_6 = Circle(Plane=yz_plane_2, Radius=expr("x/2", barrel_jack_diameter))
move_7 = Move(Geometry=circle_6, Motion="-10, 8, 30")  # -> Geometry, Transform
unit_x = UnitX(Factor="30")
extrude_3 = Extrude(Base=move_7.Geometry, Direction=unit_x)
cap_holes_2 = CapHoles(Brep=extrude_3)
barrel_jack_hole = Brep(cap_holes_2)  # disabled

# ----
# Speaker Support
speaker_body_2 = Brep(speaker_body)
bounding_box = BoundingBox(Content=speaker_body_2, Plane=PlaneXY(0, 0, 0))  # -> Box, Box_2
area = Area(Geometry=bounding_box.Box)  # -> Area, Centroid
unit_z_3 = UnitZ(Factor="-4.0")
box_bottom_cl = BoxBaseCL(box=bounding_box.Box)
deconstruct = Deconstruct(Point=area.Centroid)  # -> XComponent, YComponent, ZComponent
move_8 = Move(Geometry=area.Centroid, Motion=unit_z_3)  # -> Geometry, Transform
construct_point_3 = ConstructPoint(XCoordinate=deconstruct.XComponent, YCoordinate=deconstruct.YComponent, ZCoordinate="0")
merge = Merge(Data1=box_bottom_cl, Data2=move_8.Geometry, Data3=construct_point_3)  # -> flatten(Result)
bounding_box_2 = BoundingBox(Content=merge, Plane=PlaneXY(0, 0, 0), UnionBox=True)  # -> Box, Box_2
solid_difference = SolidDifference(BrepsA=bounding_box_2.Box, BrepsB=speaker_body_2)
speaker_support = Brep(solid_difference)

# ---- group: Speaker Holes
face_speaker_surface_2 = Surface(face_speaker_surface)
speaker_hole_size = Slider(1.1, range=1..3)
speaker_placement_transform_2 = Transform(speaker_placement_transform)
number_slider = Slider(5.4, range=1..40)
number_slider_2 = Slider(6, range=1..30)
planar_grid = PlanarGrid(
    BasePoint="-100, 0, 0",
    IDir=Vector(1, 0, 0),
    JDir=Vector(0, 1, 0),
    IDistance=number_slider,
    JDistance=number_slider,
    INumber=number_slider_2,
    JNumber=number_slider_2)  # -> flatten(Grid)
bounding_box_3 = BoundingBox(Content=planar_grid, Plane=PlaneXY(0, 0, 0), UnionBox=True)  # -> Box, Box_2
area_2 = Area(Geometry=face_speaker_surface_2)  # -> Area, Centroid
area_3 = Area(Geometry=bounding_box_3.Box)  # -> Area, Centroid
move_to_point = MoveToPoint(Geometry=planar_grid, PointA=area_3.Centroid, PointB=area_2.Centroid)  # -> Moved, Vector, Transform
circle_7 = Circle(Plane=move_to_point.Moved, Radius=speaker_hole_size)
move_9 = Move(Geometry=circle_7, Motion="0, 0, -5")  # -> graft(Geometry), Transform
patch_4 = Patch(Curves=move_9.Geometry, Spans=20, Flexibility=1, Trim=True)
extrude_4 = Extrude(Base=patch_4, Direction="0, 0, 30")
transform_2 = Transform(Geometry=extrude_4, Transform=speaker_placement_transform_2)  # -> flatten(Geometry)
speaker_hole_knockouts = Brep(transform_2)

# ----
# Main PCB
screw_pillar_wall_thickness = Panel("2.0")
translation_vector_2 = Panel("75, 0, 0")
pcb_x = Panel("55.0")
pcb_protect_above = Panel("14.0")
pcb_hole_diameter = Panel("2.9")
pcb_y = Panel("47.0")
pcb_protect_below = Panel("31.0")
screw_hole_points = Panel("""3.5, 4.0, 0
51.0, 4.0, 0
3.5, 43.75, 0
51.0, 43.75, 0""")
# Think about PCBs
# 
# Inputs
# 
# The dimensions of the board (based on the back plane of the board, with x:0, y:0 being the lower left of the board when facing it)
# 
# 
# Protect height above
# Protect height below
# Knock out profile shapes that will be extruded outward from the board. and be used to remove external walls
box_wall_thickness = Panel("2.0")
vector_2 = Vector(translation_vector_2)

# ---- group: usb-c knockout
pcb_x_2 = Number(pcb_x)
addition = Addition(A=pcb_x_2, B="10")
addition_2 = Addition(A=pcb_x_2, B="-10")
construct_point_4 = ConstructPoint(XCoordinate=addition, YCoordinate="37.5", ZCoordinate="10.0")
construct_point_5 = ConstructPoint(XCoordinate=addition_2, YCoordinate="20.0", ZCoordinate="3.0")
box_2pt_2 = Box2Pt(PointA=construct_point_5, PointB=construct_point_4, Plane=PlaneXY(0, 0, 0))

# ---- group: Antenna Top Square Hole
xz_plane_3 = XZPlane(Origin=Point(0, 0, 0))
unit_y_3 = UnitY(Factor="30.0")

# ---- group: Grounding Square Hole
rectangle = Rectangle(Plane=xz_plane_3, XSize="3.5", YSize="8.0", Radius=0)  # -> Rectangle, Length
unit_y_4 = UnitY(Factor="30.0")
patch_5 = Patch(Curves=rectangle.Rectangle, Spans=20, Flexibility=1, Trim=True)
extrude_5 = Extrude(Base=patch_5, Direction=unit_y_4)
move_10 = Move(Geometry=extrude_5, Motion="9.0, 40, 0.0")  # -> Geometry, Transform

# ----
rectangle_2 = Rectangle(Plane=xz_plane_3, XSize="3.5", YSize="8.0", Radius=0)  # -> Rectangle, Length

# ---- group: Antenna Top Square Hole (continued)
patch_6 = Patch(Curves=rectangle_2.Rectangle, Spans=20, Flexibility=1, Trim=True)
extrude_6 = Extrude(Base=patch_6, Direction=unit_y_3)
move_11 = Move(Geometry=extrude_6, Motion="38.0, 40, 0.0")  # -> Geometry, Transform

# ----
main_pcb_cl = MainPCBCL(
    pcb_x=pcb_x,
    pcb_y=pcb_y,
    pcb_protect_above_mm=pcb_protect_above,
    pcb_protect_below_mm=pcb_protect_below,
    screw_holes=screw_hole_points,
    knockout_breps=[box_2pt_2, box_2pt, move_2.Geometry, move.Geometry, move_11.Geometry, move_10.Geometry],
    screw_d=pcb_hole_diameter,
    wall_thickness=screw_pillar_wall_thickness,
    transform=vector_2)  # -> geometry, geometry_3, geometry_2, protectabovevol

# ----
# Relays
screw_pillar_wall_thickness_2 = Panel("2.0")
translation_vector_3 = Panel("3, 45, 0")
pcb_y_2 = Panel("70.5")
pcb_x_3 = Panel("17.25")
screw_hole_points_2 = Panel("""1.88, 2.15, 0
15.5, 2.15, 0
1.88, 68.17, 0
15.5, 68.17, 0""")
translation_vector_4 = Panel("3, 26, 0")
pcb_protect_above_2 = Panel("18.0")
pcb_hole_diameter_2 = Panel("2.0")
pcb_protect_below_2 = Panel("5.0")
vector_3 = Vector(translation_vector_3)
vector_4 = Vector(translation_vector_4)
xy_plane_2 = XYPlane(Origin=Point(0, 0, 0))
move_12 = Move(Motion=vector_4)  # -> Geometry, Transform
rotate_2 = Rotate(Angle=degrees("-90"), Plane=xy_plane_2)  # -> Geometry, Transform
compound_2 = Compound(Transforms=[rotate_2.Transform, move_12.Transform])
compound_3 = Compound(Transforms=[rotate_2.Transform, vector_3])

# ---- group: relay terminal knockout
z_low_2 = Panel("1.0")
panel = Panel(pcb_x_3)
z_high_2 = Panel("10.0")
construct_point_6 = ConstructPoint(XCoordinate=panel, YCoordinate="-10.0", ZCoordinate=z_low_2)
construct_point_7 = ConstructPoint(XCoordinate="0", YCoordinate="10", ZCoordinate=z_high_2)
box_2pt_3 = Box2Pt(PointA=construct_point_7, PointB=construct_point_6, Plane=PlaneXY(0, 0, 0))

# ----
pcb_region = MainPCBCL(
    pcb_x=pcb_x_3,
    pcb_y=pcb_y_2,
    pcb_protect_above_mm=pcb_protect_above_2,
    pcb_protect_below_mm=pcb_protect_below_2,
    screw_holes=screw_hole_points_2,
    knockout_breps=box_2pt_3,
    screw_d=pcb_hole_diameter_2,
    wall_thickness=screw_pillar_wall_thickness_2,
    transform=compound_3)  # -> geometry, geometry_3, geometry_2, protectabovevol
pcb_region_2 = MainPCBCL(
    pcb_x=pcb_x_3,
    pcb_y=pcb_y_2,
    pcb_protect_above_mm=pcb_protect_above_2,
    pcb_protect_below_mm=pcb_protect_below_2,
    screw_holes=screw_hole_points_2,
    knockout_breps=box_2pt_3,
    screw_d=pcb_hole_diameter_2,
    wall_thickness=screw_pillar_wall_thickness_2,
    transform=compound_2)  # -> geometry, geometry_3, geometry_2, protectabovevol

# ----
# Contained
# Components
number_slider_3 = Slider(241, range=0..1000)
internal_components = Merge(
    Data1=main_pcb_cl.geometry,
    Data2=main_pcb_cl.geometry_3,
    Data3=pcb_region.geometry,
    Data4=pcb_region.geometry_3,
    Data5=pcb_region_2.geometry,
    Data6=pcb_region_2.geometry_3,
    Data7=speaker_body)  # -> flatten(Result)
protectabovevolumes = Merge(Data1=main_pcb_cl.protectabovevol, Data2=pcb_region.protectabovevol, Data3=pcb_region_2.protectabovevol)  # -> flatten(Result)
screw_pillars = Merge(Data1=main_pcb_cl.geometry_3, Data2=pcb_region.geometry_3, Data3=pcb_region_2.geometry_3)
knockouts = Merge(Data1=main_pcb_cl.geometry_2, Data2=pcb_region.geometry_2, Data3=pcb_region_2.geometry_2, Data4=speaker_hole_knockouts)
random_color = RandomColor(Data=knockouts, Seed=number_slider_3, FastMode=False)
colour_picker = ColourPicker(PickedColour=RGB(255, 0, 45))
colour_picker_2 = ColourPicker(PickedColour=RGB(70, 149, 146))
custom_preview = CustomPreview(Geometry=protectabovevolumes, Material=colour_picker)
custom_preview_2 = CustomPreview(Geometry=knockouts, Material=colour_picker_2)

# ----
# Box Wall Construction
interior_part_offset_mm = Panel("0.5")
gnd_anchored_bounding_box_cl = GNDAnchoredBoundingBoxCL(content=internal_components, offset_mm=interior_part_offset_mm)
box_interior = Brep(gnd_anchored_bounding_box_cl)
offset_box_cl = OffsetBoxCL(brep=box_interior, offset_mm=box_wall_thickness)
offset_box = Brep(offset_box_cl)
box_top_cl = BoxTopCL(box=offset_box)

# ----
# ON and EMF Text
panel_2 = Panel("-8, 0, 0")
box_exterior = Brep(offset_box_cl)
text_size = Slider(6, range=5..12)
text = Panel("ON")
text_size_2 = Slider(12, range=5..12)
text_2 = Panel("EMF")
text_3 = Panel("NCV-ShakeIt")
explode_object = ExplodeObject(Object=box_exterior, Recursive=False)
area_4 = Area(Geometry=explode_object)  # -> Area, Centroid
deconstruct_2 = Deconstruct(Point=area_4.Centroid)  # -> XComponent, YComponent, ZComponent
panel_3 = Panel("-0.7")
panel_4 = Panel("-2.0")
sort_list = SortList(Keys=deconstruct_2.ZComponent, ValuesValuesA=explode_object)  # -> Keys, ValuesValuesA
vector_5 = Vector("0, 0, 3.0")
list_item = ListItem(List=sort_list.ValuesValuesA, Index="-1", Wrap=True)
top_box_surface = Surface(list_item)
top_box_surface_2 = Surface(top_box_surface)
explode = Explode(Curve=top_box_surface_2, Recursive=True)  # -> Segments, Vertices
midpoint = Midpoint(Curve=explode.Segments)
deconstruct_3 = Deconstruct(Point=midpoint)  # -> XComponent, YComponent, ZComponent
sort_list_2 = SortList(Keys=deconstruct_3.YComponent, ValuesValuesA=explode.Segments)  # -> Keys, ValuesValuesA
sort_list_3 = SortList(Keys=deconstruct_3.XComponent, ValuesValuesA=explode.Segments)  # -> Keys, ValuesValuesA
list_item_2 = ListItem(List=sort_list_2.ValuesValuesA, Index="0", Wrap=True)
list_item_3 = ListItem(List=sort_list_3.ValuesValuesA, Index="-1", Wrap=True)
min_y_lid_line = Curve(list_item_2)
min_y_lid_line_2 = Curve(min_y_lid_line)
move_13 = Move(Geometry=min_y_lid_line_2, Motion="-10, 35, 0")  # -> Geometry, Transform
text_on_surface = TextOnSurface(Text=text_3, Font="Helvetica", Height=text_size_2, Depth="0.0", BaseLine=move_13.Geometry, BaseSurface=top_box_surface_2)
max_x_lid_line = Curve(list_item_3)
max_x_lid_line_2 = Curve(max_x_lid_line)
move_14 = Move(Geometry=max_x_lid_line_2, Motion="-7, -13, 0")  # -> Geometry, Transform
move_15 = Move(Geometry=move_14.Geometry, Motion=panel_2)  # -> Geometry, Transform
text_on_surface_2 = TextOnSurface(Text=text_2, Font="Helvetica", Height=text_size, Depth="0.0", BaseLine=move_15.Geometry, BaseSurface=top_box_surface_2)
text_on_surface_3 = TextOnSurface(Text=text, Font="Helvetica", Height=text_size, Depth="0.0", BaseLine=move_14.Geometry, BaseSurface=top_box_surface_2)
extrude_7 = Extrude(Base=[text_on_surface_3, text_on_surface_2, text_on_surface], Direction=vector_5)
lid_text = Brep(extrude_7)

# ---- group: Box Splitter Volume
# Box Splitter Volume (for separating lid)
wall_thickness = Number(box_wall_thickness)
box_top = Surface(box_top_cl)
negative_3 = Negative(Value=wall_thickness)
unit_z_4 = UnitZ(Factor=negative_3)
move_16 = Move(Geometry=box_top, Motion=unit_z_4)  # -> Geometry, Transform
extend_surface = ExtendSurface(Surface=move_16.Geometry, WestEdge="10", SouthEdge="10", EastEdge="10", NorthEdge="10", ExtensionType=True)
unit_z_5 = UnitZ(Factor="1000")
area_5 = Area(Geometry=extend_surface)  # -> Area, Centroid
move_17 = Move(Geometry=area_5.Centroid, Motion=unit_z_5)  # -> Geometry, Transform
bounding_box_4 = BoundingBox(Content=[move_17.Geometry, extend_surface], Plane=PlaneXY(0, 0, 0), UnionBox=True)  # -> Box, Box_2
splitter_box = Brep(bounding_box_4.Box)

# ----
# Interfering Pillar Fix
number_slider_4 = Slider(1, range=0..11)
screw_pillars_2 = Brep(flatten(screw_pillars))
list_item_4 = ListItem(List=screw_pillars_2, Index=number_slider_4, Wrap=True)
cull_index = CullIndex(List=screw_pillars_2, Indices=number_slider_4, Wrap=True)
xz_plane_4 = XZPlane(Origin=Point(0, 0, 0))
circle_8 = Circle(Plane=xz_plane_4, Radius="21.0")
move_18 = Move(Geometry=circle_8, Motion="105, 0, 18")  # -> Geometry, Transform
unit_y_5 = UnitY(Factor="30.0")
extrude_8 = Extrude(Base=move_18.Geometry, Direction=unit_y_5)
solid_difference_2 = SolidDifference(BrepsA=list_item_4, BrepsB=extrude_8)
merge_2 = Merge(Data1=cull_index, Data2=solid_difference_2)  # -> flatten(Result)
screw_pillars_3 = Brep(merge_2)

open_box_top_srf = Surface(extend_surface)

# ----
# GND Text
open_box_top_srf_2 = Surface(open_box_top_srf)
main_pcb_knockouts = Brep(main_pcb_cl.geometry_2)
box_exterior_2 = Brep(offset_box_cl)
explode_object_2 = ExplodeObject(Object=box_exterior_2, Recursive=False)
area_6 = Area(Geometry=explode_object_2)  # -> Area, Centroid
list_item_5 = ListItem(List=main_pcb_knockouts, Index=Slider(4, range=0..10), Wrap=True)
gnd_knockout = Brep(list_item_5)
deconstruct_4 = Deconstruct(Point=area_6.Centroid)  # -> XComponent, YComponent, ZComponent
vector_6 = Vector("0, 1, 1")
explode_object_3 = ExplodeObject(Object=gnd_knockout, Recursive=False)
sort_list_4 = SortList(Keys=deconstruct_4.YComponent, ValuesValuesA=explode_object_2)  # -> Keys, ValuesValuesA
area_7 = Area(Geometry=explode_object_3)  # -> Area, Centroid
list_item_6 = ListItem(List=sort_list_4.ValuesValuesA, Index="-1", Wrap=True)
deconstruct_5 = Deconstruct(Point=area_7.Centroid)  # -> XComponent, YComponent, ZComponent
antenna_hole_box_surface = Surface(list_item_6)
sort_list_5 = SortList(Keys=deconstruct_5.XComponent, ValuesValuesA=explode_object_3)  # -> Keys, ValuesValuesA
list_item_7 = ListItem(List=sort_list_5.ValuesValuesA, Index="-1", Wrap=True)
brep_brep = BrepBrep(BrepA=antenna_hole_box_surface, BrepB=list_item_7)  # -> Curves, Points
max_x_knockout_line = Curve(brep_brep.Curves)
max_x_knockout_line_2 = Curve(max_x_knockout_line)
end_points = EndPoints(Curve=max_x_knockout_line_2)  # -> Start, End
brep_closest_point = BrepClosestPoint(Point=end_points.Start, Brep=open_box_top_srf_2)  # -> Point, Normal, Distance
curve_closest_point = CurveClosestPoint(Point=brep_closest_point.Point, Curve=max_x_knockout_line_2)  # -> Point, Parameter, Distance
line = Line(StartPoint=curve_closest_point.Point, EndPoint=brep_closest_point.Point)
extend_curve = ExtendCurve(Curve=line, Type=0, Start="-0.7", End="-2.0")
text_base_line = Line(extend_curve)
text_base_line_2 = Line(text_base_line)
move_19 = Move(Geometry=text_base_line_2, Motion="-1.5, 0, -16")  # -> Geometry, Transform
text_on_surface_4 = TextOnSurface(
    Text="G",
    Font="Helvetica",
    Height=Slider(8, range=5..12),
    Depth="0.0",
    BaseLine=move_19.Geometry,
    BaseSurface=antenna_hole_box_surface)
extrude_9 = Extrude(Base=text_on_surface_4, Direction=vector_6)
gnd_text = Brep(extrude_9)

# ----
# POT Text
open_box_top_srf_3 = Surface(open_box_top_srf)
main_pcb_knockouts_2 = Brep(main_pcb_cl.geometry_2)
box_exterior_3 = Brep(offset_box_cl)
number_slider_5 = Slider(8, range=5..12)
explode_object_4 = ExplodeObject(Object=box_exterior_3, Recursive=False)
area_8 = Area(Geometry=explode_object_4)  # -> Area, Centroid
list_item_8 = ListItem(List=main_pcb_knockouts_2, Index=Slider(1, range=0..10), Wrap=True)
pots_knockout = Brep(list_item_8)
deconstruct_6 = Deconstruct(Point=area_8.Centroid)  # -> XComponent, YComponent, ZComponent
explode_object_5 = ExplodeObject(Object=pots_knockout, Recursive=False)
sort_list_6 = SortList(Keys=deconstruct_6.YComponent, ValuesA=explode_object_4)  # -> Keys, ValuesA
area_9 = Area(Geometry=explode_object_5)  # -> Area, Centroid
vector_7 = Vector("0, -1, 1")
list_item_9 = ListItem(List=sort_list_6.ValuesA, Index="0", Wrap=True)
deconstruct_7 = Deconstruct(Point=area_9.Centroid)  # -> XComponent, YComponent, ZComponent
pot_hole_surface = Surface(list_item_9)
sort_list_7 = SortList(Keys=deconstruct_7.XComponent, ValuesValuesA=explode_object_5)  # -> Keys, ValuesValuesA
list_item_10 = ListItem(List=sort_list_7.ValuesValuesA, Index="0", Wrap=True)
brep_brep_2 = BrepBrep(BrepA=pot_hole_surface, BrepB=list_item_10)  # -> Curves, Points
left_side_knockout_line = Line(brep_brep_2.Curves)
left_side_knockout_line_2 = Line(left_side_knockout_line)
end_points_2 = EndPoints(Curve=left_side_knockout_line_2)  # -> Start, End
brep_closest_point_2 = BrepClosestPoint(Point=end_points_2.Start, Brep=open_box_top_srf_3)  # -> Point, Normal, Distance
curve_closest_point_2 = CurveClosestPoint(Point=brep_closest_point_2.Point, Curve=left_side_knockout_line_2)  # -> Point, Parameter, Distance
line_2 = Line(StartPoint=curve_closest_point_2.Point, EndPoint=brep_closest_point_2.Point)
extend_curve_2 = ExtendCurve(Curve=line_2, Type=0, Start="-0.7", End="-2.0")
text_base_line_3 = Line(extend_curve_2)
text_base_line_4 = Line(text_base_line_3)
move_20 = Move(Geometry=text_base_line_4, Motion="6, 0, 0")  # -> Geometry, Transform
move_21 = Move(Geometry=move_20.Geometry, Motion="15, 0, 0")  # -> Geometry, Transform
text_on_surface_5 = TextOnSurface(
    Text="SQ",
    Font="Helvetica",
    Height=number_slider_5,
    Depth="0.0",
    BaseLine=move_20.Geometry,
    BaseSurface=pot_hole_surface)
text_on_surface_6 = TextOnSurface(
    Text="RUN T",
    Font="Helvetica",
    Height=number_slider_5,
    Depth="0.0",
    BaseLine=move_21.Geometry,
    BaseSurface=pot_hole_surface)
extrude_10 = Extrude(Base=[text_on_surface_5, text_on_surface_6], Direction=vector_7)
pots_text = Brep(extrude_10)

# ----
# Antenna Text
open_box_top_srf_4 = Surface(open_box_top_srf)
main_pcb_knockouts_3 = Brep(main_pcb_cl.geometry_2)
box_exterior_4 = Brep(offset_box_cl)
explode_object_6 = ExplodeObject(Object=box_exterior_4, Recursive=False)
area_10 = Area(Geometry=explode_object_6)  # -> Area, Centroid
list_item_11 = ListItem(List=main_pcb_knockouts_3, Index=Slider(3, range=0..10), Wrap=True)
pots_knockout_2 = Brep(list_item_11)
vector_8 = Vector("0, 1, 1")
deconstruct_8 = Deconstruct(Point=area_10.Centroid)  # -> XComponent, YComponent, ZComponent
explode_object_7 = ExplodeObject(Object=pots_knockout_2, Recursive=False)
sort_list_8 = SortList(Keys=deconstruct_8.YComponent, ValuesValuesA=explode_object_6)  # -> Keys, ValuesValuesA
area_11 = Area(Geometry=explode_object_7)  # -> Area, Centroid
list_item_12 = ListItem(List=sort_list_8.ValuesValuesA, Index="-1", Wrap=True)
deconstruct_9 = Deconstruct(Point=area_11.Centroid)  # -> XComponent, YComponent, ZComponent
antenna_hole_box_surface_2 = Surface(list_item_12)
sort_list_9 = SortList(Keys=deconstruct_9.XComponent, ValuesValuesA=explode_object_7)  # -> Keys, ValuesValuesA
list_item_13 = ListItem(List=sort_list_9.ValuesValuesA, Index="-1", Wrap=True)
brep_brep_3 = BrepBrep(BrepA=antenna_hole_box_surface_2, BrepB=list_item_13)  # -> Curves, Points
max_x_knockout_line_3 = Curve(brep_brep_3.Curves)
max_x_knockout_line_4 = Curve(max_x_knockout_line_3)
end_points_3 = EndPoints(Curve=max_x_knockout_line_4)  # -> Start, End
brep_closest_point_3 = BrepClosestPoint(Point=end_points_3.Start, Brep=open_box_top_srf_4)  # -> Point, Normal, Distance
curve_closest_point_3 = CurveClosestPoint(Point=brep_closest_point_3.Point, Curve=max_x_knockout_line_4)  # -> Point, Parameter, Distance
line_3 = Line(StartPoint=curve_closest_point_3.Point, EndPoint=brep_closest_point_3.Point)
extend_curve_3 = ExtendCurve(Curve=line_3, Type=0, Start="-0.7", End="-2.0")
text_base_line_5 = Line(extend_curve_3)
text_base_line_6 = Line(text_base_line_5)
move_22 = Move(Geometry=text_base_line_6, Motion="-1.5, 0, -16")  # -> Geometry, Transform
text_on_surface_7 = TextOnSurface(
    Text="A",
    Font="Helvetica",
    Height=Slider(8, range=5..12),
    Depth="0.0",
    BaseLine=move_22.Geometry,
    BaseSurface=antenna_hole_box_surface_2)
extrude_11 = Extrude(Base=text_on_surface_7, Direction=vector_8)
ant_text = Brep(extrude_11)

# ---- group: Screw Holes
box_top_surface = Surface(box_top_cl)
screw_diameter = Panel("2.0")
holes_per_side = Panel("2")
screw_length = Panel("10.0")
screw_hole_edge_offset = Panel("0.0")
offset_curve = OffsetCurve(Curve=box_top_surface, Distance=screw_hole_edge_offset, Corners=1)
explode_2 = Explode(Curve=offset_curve, Recursive=True)  # -> Segments, Vertices
holes_per_side_2 = Number(holes_per_side)
cull_usb_screw = Slider(5, range=0..8)
divide_curve = DivideCurve(Curve=explode_2.Segments, Count=holes_per_side_2, Kinks=False)  # -> Points, Tangents, Parameters
cull_overlapping_holes = CullIndex(List=divide_curve.Points, Indices="-1", Wrap=True)  # -> flatten(List)
cull_usb_screw_2 = CullIndex(List=cull_overlapping_holes, Indices=cull_usb_screw, Wrap=True)  # -> flatten(List)
screw_position_points = Point(flatten(cull_usb_screw_2))
negative_4 = Negative(Value=screw_length)
unit_z_6 = UnitZ(Factor=negative_4)

# ----
screw_radius = Number(expr("x/2", screw_diameter))

# ---- group: Screw Holes (continued)
circle_9 = Circle(Plane=screw_position_points, Radius=screw_radius)  # -> graft(Circle)
patch_7 = Patch(Curves=circle_9, Spans=20, Flexibility=1, Trim=True)
extrude_12 = Extrude(Base=patch_7, Direction=unit_z_6)  # -> flatten(Extrusion)

# ----
# Screw Channels
screw_position_points_2 = Point(screw_position_points)
screw_diameter_2 = Number(screw_radius)
screw_length_2 = Number(screw_length)
screw_hole_breps = Brep(extrude_12)
screw_hole_vector = Vector(unit_z_6)
screwchannelformspy = Python3Script(
    screw_hole_pts=screw_position_points_2,
    screw_hole_breps=screw_hole_breps,
    screw_hole_vector=screw_hole_vector,
    screw_l=screw_length_2,
    screw_d=screw_diameter_2)  # -> out, screw_channels; inputs screw_hole_pts: list of Point3d, screw_hole_breps: list of Brep, screw_hole_vector: Vector3d, screw_l: Double, screw_d: Double
# ---------- screwchannelformspy: Python ----------
import Rhino.Geometry as geo

tol = 0.05
screw_channels = []
channel_extend_factor = 1.25

for i, pt in enumerate(screw_hole_pts):  

    screw_line = geo.LineCurve(geo.Line(pt, screw_hole_vector, screw_l))
    screw_line_extended = geo.Line(pt, screw_hole_vector, screw_l * channel_extend_factor)

    frames = screw_line.GetPerpendicularFrames([0.0, float(screw_line.Domain[1])])
    #print(f"{frames=} domain={screw_line.Domain}")

    topCircle = None
    bottomCircle = None

    print(f"{frames[0]=}")

    topCircleRes = geo.Intersect.Intersection.BrepPlane(screw_hole_breps[i],frames[0],tol) #see weird unpacking here: https://discourse.mcneel.com/t/brep-plane-intersection-python-script/176541/3
    if topCircleRes and topCircleRes[0]:
        if topCircleRes[1]:
            topCircle = topCircleRes[1][0] #Making the assumption that one circle is returned
        else:
            print("No topCircle Result")

    bottomCircleRes = geo.Intersect.Intersection.BrepPlane(screw_hole_breps[i],frames[1],tol)
    if bottomCircleRes and bottomCircleRes[0]:
        if bottomCircleRes[1]:
            bottomCircle = bottomCircleRes[1][0] #Making the assumption that one circle is returned
        else:
            print("No topCircle Result")


    topCircleExpanded = topCircle.Offset(frames[0], screw_d, tol, geo.CurveOffsetCornerStyle.Smooth)
    bottomCircleExpanded = bottomCircle.Offset(frames[1], screw_d, tol, geo.CurveOffsetCornerStyle.Smooth)

    topCircleExpanded: geo.Curve = topCircleExpanded[0]
    bottomCircleExpanded: geo.Curve = bottomCircleExpanded[0]

    l = screw_line_extended
    tipCircle = topCircleExpanded.Duplicate()
    tipCircle.Translate(l.ToX - l.FromX, l.ToY - l.FromY, l.ToZ - l.FromZ)
    tipCircle.Transform(geo.Transform.Scale(l.To, .01))

    print(f"{type(topCircleExpanded)}{topCircleExpanded=} {type(bottomCircleExpanded)}{bottomCircleExpanded=}")
    screw_channel = geo.Brep.CreateFromLoft([topCircleExpanded, bottomCircleExpanded, tipCircle], geo.Point3d.Unset, geo.Point3d.Unset, geo.LoftType.Straight, False)
    print(f"{screw_channel=} len={len(screw_channel)}")
    screw_channels.append(screw_channel[0])
# ---------- end screwchannelformspy ----------
cap_holes_3 = CapHoles(Brep=screwchannelformspy.screw_channels)
screw_channels = Brep(cap_holes_3)

# ----
# Box Mounting Tabs
attachment_tab_width = Panel("12.0")
screw_hole_d = Panel("5.0")
box_base_cl = BoxBaseCL(box=offset_box)
box_wall_thickness_2 = Number(box_wall_thickness)
explode_3 = Explode(Curve=box_base_cl, Recursive=True)  # -> Segments, Vertices
unit_x_2 = UnitX(Factor=expr("-x", attachment_tab_width))
unit_x_3 = UnitX(Factor=expr("-x/2", attachment_tab_width))
panel_5 = Panel("""0.15
0.85""")
unit_z_7 = UnitZ(Factor=box_wall_thickness_2)

# ---- group: Left Edge
midpoint_2 = Midpoint(Curve=explode_3.Segments)
deconstruct_10 = Deconstruct(Point=midpoint_2)  # -> XComponent, YComponent, ZComponent
sort_list_10 = SortList(Keys=deconstruct_10.XComponent, ValuesValuesA=explode_3.Segments)  # -> Keys, ValuesValuesA
list_item_14 = ListItem(List=sort_list_10.ValuesValuesA, Index="0", Wrap=True)

# ---- group: Side Edge
midpoint_3 = Midpoint(Curve=explode_3.Segments)
deconstruct_11 = Deconstruct(Point=midpoint_3)  # -> XComponent, YComponent, ZComponent
sort_list_11 = SortList(Keys=deconstruct_11.XComponent, ValuesValuesA=explode_3.Segments)  # -> Keys, ValuesValuesA
list_item_15 = ListItem(List=sort_list_11.ValuesValuesA, Index="1", Wrap=True)

# ----
box_edge = Line(list_item_14)
end_points_4 = EndPoints(Curve=box_edge)  # -> Start, End
move_23 = Move(Geometry=box_edge, Motion=unit_x_3)  # -> Geometry, Transform
move_24 = Move(Geometry=end_points_4.Start, Motion=unit_x_2)  # -> Geometry, Transform
rectangle_3pt = Rectangle3Pt(PointA=end_points_4.Start, PointB=end_points_4.End, PointC=move_24.Geometry)  # -> Rectangle, Length
evaluate_curve = EvaluateCurve(Curve=move_23.Geometry, Parameter=panel_5)  # -> Point, Tangent, Angle
midpoint_4 = Midpoint(Curve=move_23.Geometry)
circle_10 = Circle(Plane=evaluate_curve.Point, Radius=expr("x/2", screw_hole_d))
length = Length(Curve=list_item_15)
boundary_surfaces = BoundarySurfaces(Edges=[rectangle_3pt.Rectangle, circle_10])
addition_3 = Addition(A=length, B=attachment_tab_width)
extrude_13 = Extrude(Base=boundary_surfaces, Direction=unit_z_7)
unit_x_4 = UnitX(Factor=addition_3)
move_25 = Move(Geometry=extrude_13, Motion=unit_x_4)  # -> Geometry, Transform
left_tab = Brep(extrude_13)
right_tab = Brep(move_25.Geometry)

# ---- group: Main Components
barrel_jack_hole_2 = Brep(barrel_jack_hole)
splitter_box_2 = Brep(splitter_box)
box_exterior_5 = Brep(offset_box_cl)
screw_channels_2 = Brep(flatten(screw_channels))
knockouts_2 = Brep(knockouts)
box_interior_2 = Brep(box_interior)
screw_holes = Brep(extrude_12)
right_tab_2 = Brep(right_tab)
left_tab_2 = Brep(left_tab)
speaker_support_2 = Brep(speaker_support)
gnd_text_2 = Brep(gnd_text)
ant_text_2 = Brep(ant_text)
pots_text_2 = Brep(pots_text)
screw_pillars_4 = Brep(screw_pillars_3)
lid_text_2 = Brep(lid_text)

# ----
# Final Assembly
contact_nudge = Panel("0.1")
merge_3 = Merge(Data1=box_exterior_5, Data2=screw_channels_2)  # -> flatten(Result)
negative_5 = Negative(Value=contact_nudge)
solid_union = SolidUnion(Breps=merge_3)
unit_z_8 = UnitZ(Factor=negative_5)
negative_6 = Negative(Value="0.2")
move_26 = Move(Geometry=speaker_support_2, Motion=unit_z_8)  # -> Geometry, Transform
unit_y_6 = UnitY(Factor=negative_6)
move_27 = Move(Geometry=move_26.Geometry, Motion=unit_y_6)  # -> Geometry, Transform
unit_z_9 = UnitZ(Factor="100")
unit_z_10 = UnitZ(Factor="150")
colour_picker_3 = ColourPicker(PickedColour=RGB(0, 84, 146))

# ---- group: Contact Nudge
negative_7 = Negative(Value=contact_nudge)
unit_z_11 = UnitZ(Factor=negative_7)
move_28 = Move(Geometry=screw_pillars_4, Motion=unit_z_11)  # -> Geometry, Transform

unit_z_12 = UnitZ(Factor=contact_nudge)
move_29 = Move(Geometry=screw_holes, Motion=unit_z_12)  # -> Geometry, Transform

# ----
merge_4 = Merge(Data1=knockouts_2, Data2=box_interior_2, Data3=move_29.Geometry, Data4=barrel_jack_hole_2)  # -> flatten(Result)
solid_difference_3 = SolidDifference(BrepsA=solid_union, BrepsB=merge_4)
solid_intersection = SolidIntersection(BrepsA=solid_difference_3, BrepsB=splitter_box_2)
solid_difference_4 = SolidDifference(BrepsA=solid_difference_3, BrepsB=splitter_box_2)
merge_5 = Merge(
    Data1=solid_difference_4,
    Data2=move_28.Geometry,
    Data3=left_tab_2,
    Data4=right_tab_2,
    Data5=move_27.Geometry,
    Data6=pots_text_2,
    Data7=ant_text_2,
    Data8=gnd_text_2)  # -> flatten(Result)
plain_lid = Brep(solid_intersection)
solid_union_2 = SolidUnion(Breps=merge_5)
merge_6 = Merge(Data1=plain_lid, Data2=lid_text_2)  # -> flatten(Result)
solid_union_3 = SolidUnion(Breps=merge_6)
move_30 = Move(Geometry=solid_union_3, Motion=unit_z_10)  # -> Geometry, Transform
move_31 = Move(Geometry=solid_union_2, Motion=unit_z_9)  # -> Geometry, Transform
list_length = ListLength(List=move_31.Geometry)
list_length_2 = ListLength(List=move_30.Geometry)
panel_6 = Panel(list_length)
panel_7 = Panel(list_length_2)
box_base = Brep(move_31.Geometry)
box_top_2 = Brep(move_30.Geometry)
custom_preview_3 = CustomPreview(Geometry=[box_top_2, box_base], Material=colour_picker_3)

# ==== cluster MainPCBCL
wall_thickness = ClusterInput()
pcb_protect_above_mm = ClusterInput()
pcb_protect_below_mm = ClusterInput()
screw_d = ClusterInput()
knockout_breps = ClusterInput()
pcb_x = ClusterInput()
transform = ClusterInput()
pcb_y = ClusterInput()
screw_holes = ClusterInput()
pcb_protect_above_mm_2 = Number(pcb_protect_above_mm)
pcb_x_2 = Number(pcb_x)
pcb_y_2 = Number(pcb_y)
pcb_protect_below_mm_2 = Number(pcb_protect_below_mm)
screw_holes_2 = Point(screw_holes)
knockout_breps_2 = Brep(flatten(knockout_breps))
transform_2 = Transform(transform)
rectangle = Rectangle(Plane=PlaneXY(0, 0, 0), XSize=pcb_x_2, YSize=pcb_y_2, Radius=0)  # -> Rectangle, Length
unit_z = UnitZ(Factor=pcb_protect_below_mm_2)
list_length = ListLength(List=screw_holes_2)
unit_z_2 = UnitZ(Factor=pcb_protect_above_mm_2)
boundary_surfaces = BoundarySurfaces(Edges=rectangle.Rectangle)
plane = Plane(screw_holes_2)
reverse = Reverse(Vector=unit_z)
negative = Negative(Value=pcb_protect_below_mm_2)
knockout_breps_3 = Brep(knockout_breps_2)
extrude = Extrude(Base=boundary_surfaces, Direction=unit_z_2)
extrude_2 = Extrude(Base=boundary_surfaces, Direction=reverse)
screw_pillar = ScrewPillar(origin_plane=plane, screw_d=screw_d, wall_thickness=wall_thickness, pillar_height=negative)
unit_z_3 = UnitZ(Factor=pcb_protect_below_mm_2)
solid_union = SolidUnion(Breps=flatten([extrude, extrude_2]))
move = Move(Geometry=extrude, Motion=unit_z_3)  # -> Geometry, Transform
move_2 = Move(Geometry=solid_union, Motion=unit_z_3)  # -> Geometry, Transform
move_3 = Move(Geometry=knockout_breps_3, Motion=unit_z_3)  # -> Geometry, Transform
move_4 = Move(Geometry=screw_pillar, Motion=unit_z_3)  # -> Geometry, Transform
transform_3 = Transform(Geometry=move.Geometry, Transform=transform_2)
transform_4 = Transform(Geometry=move_3.Geometry, Transform=transform_2)
transform_5 = Transform(Geometry=move_2.Geometry, Transform=transform_2)
transform_6 = Transform(Geometry=move_4.Geometry, Transform=transform_2)
protectabovevol = ClusterOutput(transform_3)
geometry = ClusterOutput(transform_5)
geometry_2 = ClusterOutput(transform_4)
geometry_3 = ClusterOutput(transform_6)

# ==== cluster GNDAnchoredBoundingBoxCL
content = ClusterInput()
offset_mm = ClusterInput()
bounding_box = BoundingBox(Content=content, Plane=PlaneXY(0, 0, 0), UnionBox=True)  # -> Box, Box_2
offset_mm_2 = Number(offset_mm)
deconstruct_brep = DeconstructBrep(Brep=bounding_box.Box)  # -> Faces, Edges, Vertices
offset_surface = OffsetSurface(Surface=deconstruct_brep.Faces, Distance=offset_mm_2, Retrim=True)
area = Area(Geometry=offset_surface)  # -> Area, Centroid
deconstruct = Deconstruct(Point=area.Centroid)  # -> XComponent, YComponent, ZComponent
sort_list = SortList(Keys=deconstruct.ZComponent, ValuesValuesA=offset_surface)  # -> Keys, ValuesValuesA
cull_index = CullIndex(List=sort_list.ValuesValuesA, Indices="0", Wrap=True)
bounding_box_2 = BoundingBox(Content=cull_index, Plane=PlaneXY(0, 0, 0), UnionBox=True)  # -> Box, Box_2
box = ClusterOutput(bounding_box_2.Box)

# ==== cluster OffsetBoxCL
brep = ClusterInput()
offset_mm = ClusterInput()
deconstruct_brep = DeconstructBrep(Brep=brep)  # -> Faces, Edges, Vertices
offset_mm_2 = Number(offset_mm)
offset_surface = OffsetSurface(Surface=deconstruct_brep.Faces, Distance=offset_mm_2, Retrim=True)
bounding_box = BoundingBox(Content=offset_surface, Plane=PlaneXY(0, 0, 0), UnionBox=True)  # -> Box, Box_2
box = ClusterOutput(bounding_box.Box)

# ==== cluster BoxTopCL
box = ClusterInput()
deconstruct_brep = DeconstructBrep(Brep=box)  # -> Faces, Edges, Vertices
area = Area(Geometry=deconstruct_brep.Faces)  # -> Area, Centroid
deconstruct = Deconstruct(Point=area.Centroid)  # -> XComponent, YComponent, ZComponent
sort_list = SortList(Keys=deconstruct.ZComponent, ValuesValuesA=deconstruct_brep.Faces)  # -> Keys, ValuesValuesA
list_item = ListItem(List=sort_list.ValuesValuesA, Index="-1", Wrap=True)
i = ClusterOutput(list_item)

# ==== cluster BoxBaseCL
box = ClusterInput()
deconstruct_brep = DeconstructBrep(Brep=box)  # -> Faces, Edges, Vertices
area = Area(Geometry=deconstruct_brep.Faces)  # -> Area, Centroid
deconstruct = Deconstruct(Point=area.Centroid)  # -> XComponent, YComponent, ZComponent
sort_list = SortList(Keys=deconstruct.ZComponent, ValuesValuesA=deconstruct_brep.Faces)  # -> Keys, ValuesValuesA
list_item = ListItem(List=sort_list.ValuesValuesA, Index="0", Wrap=True)
i = ClusterOutput(list_item)

# ==== cluster ScrewPillar
origin_plane = ClusterInput()
wall_thickness = ClusterInput()
pillar_height = ClusterInput()
screw_d = ClusterInput()
wall_thickness_2 = Number(wall_thickness)
origin_plane_2 = Plane(origin_plane)
pillar_height_2 = Number(pillar_height)
screw_d_2 = Number(screw_d)
tl_pcb_screw = Circle(Plane=origin_plane_2, Radius=expr("x/2", screw_d_2))
flatten_tree = FlattenTree(Tree=tl_pcb_screw, Path="{0}")
offset_curve = OffsetCurve(Curve=flatten_tree, Distance=wall_thickness_2, Corners=1)
graft_tree = GraftTree(Tree=tl_pcb_screw, IncludeEmptyLists=True, IncludeNullItems=True)
panel = Panel(graft_tree)
panel_2 = Panel(offset_curve)
merge = Merge(Data1=graft_tree, Data2=offset_curve)
unit_z = UnitZ(Factor=pillar_height_2)
loft = Loft(Curves=merge, Options={Adjust=False, Closed=False, LoftEnds=0, LoftSimp=0, LoftType=0, Rebuild=10, Refit=0.01})  # -> flatten(Loft)
panel_3 = Panel(merge)
extrude = Extrude(Base=loft, Direction=unit_z)
pillar = ClusterOutput(extrude)
