# Grasshopper definition enclosure_generation.gh (Grasshopper 1.0.8)
# plug-ins: Pufferfish, PTComponentLibrary, Wombat

# ---- group: Speaker
xy_plane = XYPlane(Origin=Point(0, 0, 0))
translation_vector = Panel("0, 0, 0")
vector = Vector(translation_vector)
move = Move(Geometry=xy_plane, Motion=vector)  # -> Geometry, Transform
circle = Circle(Plane=move.Geometry, Radius=expr("x/2", "28.0"))
negative = Negative(Value="7.0")
patch = Patch(Curves=circle, Spans=20, Flexibility=1, Trim=True)
unit_z = UnitZ(Factor=negative)
extrude = Extrude(Base=patch, Direction=unit_z)
yz_plane = YZPlane(Origin=Point(0, 0, 0))
rotate = Rotate(Angle=degrees("90"), Plane=yz_plane)  # -> Geometry, Transform
move_2 = Move(Motion="50, 0, 20")  # -> Geometry, Transform
compound = Compound(Transforms=[rotate.Transform, move_2.Transform])
transform = Transform(Geometry=extrude, Transform=compound)
speaker_body = Brep(transform)

# ---- group: Speaker Holes
speaker_hole_size = Slider(1.1, range=1..3)
number_slider = Slider(5.4, range=1..40)
number_slider_2 = Slider(6, range=1..30)
planar_grid = PlanarGrid(
    BasePoint="-100, 0, 0",
    IDir=Vector(1, 0, 0),
    JDir=Vector(0, 1, 0),
    IDistance=number_slider,
    JDistance=number_slider,
    INumber=number_slider_2,
    JNumber=number_slider_2)  # -> flatten(Grid)
bounding_box = BoundingBox(Content=planar_grid, Plane=PlaneXY(0, 0, 0), UnionBox=True)  # -> Box, Box_2
area = Area(Geometry=patch)  # -> Area, Centroid
area_2 = Area(Geometry=bounding_box.Box)  # -> Area, Centroid
move_to_point = MoveToPoint(Geometry=planar_grid, PointA=area_2.Centroid, PointB=area.Centroid)  # -> Moved, Vector, Transform
circle_2 = Circle(Plane=move_to_point.Moved, Radius=speaker_hole_size)
move_3 = Move(Geometry=circle_2, Motion="0, 0, -5")  # -> graft(Geometry), Transform
patch_2 = Patch(Curves=move_3.Geometry, Spans=20, Flexibility=1, Trim=True)
extrude_2 = Extrude(Base=patch_2, Direction="0, 0, 30")
transform_2 = Transform(Geometry=extrude_2, Transform=compound)  # -> flatten(Geometry)
speaker_hole_knockouts = Brep(transform_2)

# ---- group: potentiometers knockout
z_low = Panel("-20.0")
z_high = Panel("-9.0")
construct_point = ConstructPoint(XCoordinate="46.5", YCoordinate="10.0", ZCoordinate=z_low)
construct_point_2 = ConstructPoint(XCoordinate="19.0", YCoordinate="-10", ZCoordinate=z_high)
box_2pt = Box2Pt(PointA=construct_point_2, PointB=construct_point, Plane=PlaneXY(0, 0, 0))

# ---- group: Button Hole
xz_plane = XZPlane(Origin=Point(0, 0, 0))
button_diameter = Panel("7.5")
circle_3 = Circle(Plane=xz_plane, Radius=expr("x/2", button_diameter))
unit_y = UnitY(Factor="30.0")
patch_3 = Patch(Curves=circle_3, Spans=20, Flexibility=1, Trim=True)
extrude_3 = Extrude(Base=patch_3, Direction=unit_y)
move_4 = Move(Geometry=extrude_3, Motion="40, 40, -15")  # -> Geometry, Transform

# ---- group: Antenna Hole
xz_plane_2 = XZPlane(Origin=Point(0, 0, 0))
antenna_diameter = Panel("2.0")
circle_4 = Circle(Plane=xz_plane_2, Radius=expr("x/2", antenna_diameter))
unit_y_2 = UnitY(Factor="30.0")
patch_4 = Patch(Curves=circle_4, Spans=20, Flexibility=1, Trim=True)
extrude_4 = Extrude(Base=patch_4, Direction=unit_y_2)
move_5 = Move(Geometry=extrude_4, Motion="30, 40, -15")  # -> Geometry, Transform

# ----
# Main PCB
screw_pillar_wall_thickness = Panel("2.0")
translation_vector_2 = Panel("75, 0, 0")
pcb_x = Panel("55.0")
pcb_protect_above = Panel("14.0")
pcb_hole_diameter = Panel("2.9")
pcb_y = Panel("47.0")
pcb_protect_below = Panel("31.0")
screw_hole_points = Panel("""3.5, 4.0, 0
51.0, 4.0, 0
3.5, 43.75, 0
51.0, 43.75, 0""")
# Think about PCBs
# 
# Inputs
# 
# The dimensions of the board (based on the back plane of the board, with x:0, y:0 being the lower left of the board when facing it)
# 
# 
# Protect height above
# Protect height below
# Knock out profile shapes that will be extruded outward from the board. and be used to remove external walls
box_wall_thickness = Panel("2.0")
vector_2 = Vector(translation_vector_2)

# ---- group: usb-c knockout
pcb_x_2 = Number(pcb_x)
addition = Addition(A=pcb_x_2, B="10")
addition_2 = Addition(A=pcb_x_2, B="-10")
construct_point_3 = ConstructPoint(XCoordinate=addition, YCoordinate="37.5", ZCoordinate="10.0")
construct_point_4 = ConstructPoint(XCoordinate=addition_2, YCoordinate="20.0", ZCoordinate="3.0")
box_2pt_2 = Box2Pt(PointA=construct_point_4, PointB=construct_point_3, Plane=PlaneXY(0, 0, 0))

# ----
main_pcb_cl = MainPCBCL(
    pcb_x=pcb_x,
    pcb_y=pcb_y,
    pcb_protect_above_mm=pcb_protect_above,
    pcb_protect_below_mm=pcb_protect_below,
    screw_holes=screw_hole_points,
    knockout_breps=[box_2pt_2, box_2pt, move_5.Geometry, move_4.Geometry],
    screw_d=pcb_hole_diameter,
    wall_thickness=screw_pillar_wall_thickness,
    transform=vector_2)  # -> geometry, geometry_3, geometry_2, protectabovevol

# ----
# Relays
translation_vector_3 = Panel("3, 45, 0")
screw_pillar_wall_thickness_2 = Panel("2.0")
pcb_y_2 = Panel("70.5")
pcb_x_3 = Panel("17.25")
screw_hole_points_2 = Panel("""1.88, 2.15, 0
15.5, 2.15, 0
1.88, 68.17, 0
15.5, 68.17, 0""")
translation_vector_4 = Panel("3, 26, 0")
pcb_protect_above_2 = Panel("18.0")
pcb_hole_diameter_2 = Panel("2.0")
pcb_protect_below_2 = Panel("5.0")
vector_3 = Vector(translation_vector_3)
vector_4 = Vector(translation_vector_4)
xy_plane_2 = XYPlane(Origin=Point(0, 0, 0))
move_6 = Move(Motion=vector_4)  # -> Geometry, Transform
rotate_2 = Rotate(Angle=degrees("-90"), Plane=xy_plane_2)  # -> Geometry, Transform
compound_2 = Compound(Transforms=[rotate_2.Transform, move_6.Transform])
compound_3 = Compound(Transforms=[rotate_2.Transform, vector_3])

# ---- group: relay terminal knockout
z_low_2 = Panel("1.0")
panel = Panel(pcb_x_3)
z_high_2 = Panel("10.0")
construct_point_5 = ConstructPoint(XCoordinate=panel, YCoordinate="-10.0", ZCoordinate=z_low_2)
construct_point_6 = ConstructPoint(XCoordinate="0", YCoordinate="10", ZCoordinate=z_high_2)
box_2pt_3 = Box2Pt(PointA=construct_point_6, PointB=construct_point_5, Plane=PlaneXY(0, 0, 0))

# ----
pcb_region = MainPCBCL(
    pcb_x=pcb_x_3,
    pcb_y=pcb_y_2,
    pcb_protect_above_mm=pcb_protect_above_2,
    pcb_protect_below_mm=pcb_protect_below_2,
    screw_holes=screw_hole_points_2,
    knockout_breps=box_2pt_3,
    screw_d=pcb_hole_diameter_2,
    wall_thickness=screw_pillar_wall_thickness_2,
    transform=compound_3)  # -> geometry, geometry_3, geometry_2, protectabovevol
pcb_region_2 = MainPCBCL(
    pcb_x=pcb_x_3,
    pcb_y=pcb_y_2,
    pcb_protect_above_mm=pcb_protect_above_2,
    pcb_protect_below_mm=pcb_protect_below_2,
    screw_holes=screw_hole_points_2,
    knockout_breps=box_2pt_3,
    screw_d=pcb_hole_diameter_2,
    wall_thickness=screw_pillar_wall_thickness_2,
    transform=compound_2)  # -> geometry, geometry_3, geometry_2, protectabovevol

# ----
# Contained
# Components
number_slider_3 = Slider(241, range=0..1000)
internal_components = Merge(
    Data1=main_pcb_cl.geometry,
    Data2=main_pcb_cl.geometry_3,
    Data3=pcb_region.geometry,
    Data4=pcb_region.geometry_3,
    Data5=pcb_region_2.geometry,
    Data6=pcb_region_2.geometry_3,
    Data7=speaker_body)  # -> flatten(Result)
protectabovevolumes = Merge(Data1=main_pcb_cl.protectabovevol, Data2=pcb_region.protectabovevol, Data3=pcb_region_2.protectabovevol)  # -> flatten(Result)
screw_pillars = Merge(Data1=main_pcb_cl.geometry_3, Data2=pcb_region.geometry_3, Data3=pcb_region_2.geometry_3)
knockouts = Merge(Data1=main_pcb_cl.geometry_2, Data2=pcb_region.geometry_2, Data3=pcb_region_2.geometry_2, Data4=speaker_hole_knockouts)
random_color = RandomColor(Data=knockouts, Seed=number_slider_3, FastMode=False)
colour_picker = ColourPicker(PickedColour=RGB(255, 0, 45))
colour_picker_2 = ColourPicker(PickedColour=RGB(70, 149, 146))
custom_preview = CustomPreview(Geometry=protectabovevolumes, Material=colour_picker)
custom_preview_2 = CustomPreview(Geometry=knockouts, Material=colour_picker_2)

# ----
# Box Wall Construction
interior_part_offset_mm = Panel("0.5")
gnd_anchored_bounding_box_cl = GNDAnchoredBoundingBoxCL(content=internal_components, offset_mm=interior_part_offset_mm)
box_interior = Brep(gnd_anchored_bounding_box_cl)
offset_box_cl = OffsetBoxCL(brep=box_interior, offset_mm=box_wall_thickness)
offset_box = Brep(offset_box_cl)
box_top_cl = BoxTopCL(box=offset_box)

# ---- group: Screw Holes
box_top_surface = Surface(box_top_cl)
screw_diameter = Panel("1.69")
holes_per_side = Panel("2")
screw_length = Panel("10.0")
screw_hole_edge_offset = Panel("0.0")
offset_curve = OffsetCurve(Curve=box_top_surface, Distance=screw_hole_edge_offset, Corners=1)
explode = Explode(Curve=offset_curve, Recursive=True)  # -> Segments, Vertices
holes_per_side_2 = Number(holes_per_side)
cull_usb_screw = Slider(5, range=0..8)
divide_curve = DivideCurve(Curve=explode.Segments, Count=holes_per_side_2, Kinks=False)  # -> Points, Tangents, Parameters
cull_overlapping_holes = CullIndex(List=divide_curve.Points, Indices="-1", Wrap=True)  # -> flatten(List)
cull_usb_screw_2 = CullIndex(List=cull_overlapping_holes, Indices=cull_usb_screw, Wrap=True)  # -> flatten(List)
screw_position_points = Point(flatten(cull_usb_screw_2))
circle_5 = Circle(Plane=screw_position_points, Radius=screw_diameter)  # -> graft(Circle)
negative_2 = Negative(Value=screw_length)
patch_5 = Patch(Curves=circle_5, Spans=20, Flexibility=1, Trim=True)
unit_z_2 = UnitZ(Factor=negative_2)
extrude_5 = Extrude(Base=patch_5, Direction=unit_z_2)  # -> flatten(Extrusion)

# ---- group: Box Splitter Volume
# Box Splitter Volume (for separating lid)
wall_thickness = Number(box_wall_thickness)
box_top = Surface(box_top_cl)
negative_3 = Negative(Value=wall_thickness)
unit_z_3 = UnitZ(Factor=negative_3)
move_7 = Move(Geometry=box_top, Motion=unit_z_3)  # -> Geometry, Transform
extend_surface = ExtendSurface(Surface=move_7.Geometry, WestEdge="10", SouthEdge="10", EastEdge="10", NorthEdge="10", ExtensionType=True)
unit_z_4 = UnitZ(Factor="1000")
area_3 = Area(Geometry=extend_surface)  # -> Area, Centroid
move_8 = Move(Geometry=area_3.Centroid, Motion=unit_z_4)  # -> Geometry, Transform
bounding_box_2 = BoundingBox(Content=[move_8.Geometry, extend_surface], Plane=PlaneXY(0, 0, 0), UnionBox=True)  # -> Box, Box_2
splitter_box = Brep(bounding_box_2.Box)

# ----
# Interfering Pillar Fix
number_slider_4 = Slider(1, range=0..11)
screw_pillars_2 = Brep(flatten(screw_pillars))
list_item = ListItem(List=screw_pillars_2, Index=number_slider_4, Wrap=True)
cull_index = CullIndex(List=screw_pillars_2, Indices=number_slider_4, Wrap=True)
xz_plane_3 = XZPlane(Origin=Point(0, 0, 0))
circle_6 = Circle(Plane=xz_plane_3, Radius="21.0")
move_9 = Move(Geometry=circle_6, Motion="105, 0, 18")  # -> Geometry, Transform
unit_y_3 = UnitY(Factor="30.0")
extrude_6 = Extrude(Base=move_9.Geometry, Direction=unit_y_3)
solid_difference = SolidDifference(BrepsA=list_item, BrepsB=extrude_6)
merge = Merge(Data1=cull_index, Data2=solid_difference)  # -> flatten(Result)
screw_pillars_3 = Brep(merge)

# ----
# Screw Channels
screw_position_points_2 = Point(screw_position_points)
screw_diameter_2 = Number(screw_diameter)
screw_length_2 = Number(screw_length)
screw_hole_breps = Brep(extrude_5)
screw_hole_vector = Vector(unit_z_2)
screwchannelformspy = Python3Script(
    screw_hole_pts=screw_position_points_2,
    screw_hole_breps=screw_hole_breps,
    screw_hole_vector=screw_hole_vector,
    screw_l=screw_length_2,
    screw_d=screw_diameter_2)  # -> out, screw_channels; inputs screw_hole_pts: list of Point3d, screw_hole_breps: list of Brep, screw_hole_vector: Vector3d, screw_l: Double, screw_d: Double
# ---------- screwchannelformspy: Python ----------
import Rhino.Geometry as geo

tol = 0.05
screw_channels = []
channel_extend_factor = 1.25

for i, pt in enumerate(screw_hole_pts):  

    screw_line = geo.LineCurve(geo.Line(pt, screw_hole_vector, screw_l))
    screw_line_extended = geo.Line(pt, screw_hole_vector, screw_l * channel_extend_factor)

    frames = screw_line.GetPerpendicularFrames([0.0, float(screw_line.Domain[1])])
    #print(f"{frames=} domain={screw_line.Domain}")

    topCircle = None
    bottomCircle = None

    print(f"{frames[0]=}")

    topCircleRes = geo.Intersect.Intersection.BrepPlane(screw_hole_breps[i],frames[0],tol) #see weird unpacking here: https://discourse.mcneel.com/t/brep-plane-intersection-python-script/176541/3
    if topCircleRes and topCircleRes[0]:
        if topCircleRes[1]:
            topCircle = topCircleRes[1][0] #Making the assumption that one circle is returned
        else:
            print("No topCircle Result")

    bottomCircleRes = geo.Intersect.Intersection.BrepPlane(screw_hole_breps[i],frames[1],tol)
    if bottomCircleRes and bottomCircleRes[0]:
        if bottomCircleRes[1]:
            bottomCircle = bottomCircleRes[1][0] #Making the assumption that one circle is returned
        else:
            print("No topCircle Result")


    topCircleExpanded = topCircle.Offset(frames[0], screw_d, tol, geo.CurveOffsetCornerStyle.Smooth)
    bottomCircleExpanded = bottomCircle.Offset(frames[1], screw_d, tol, geo.CurveOffsetCornerStyle.Smooth)

    topCircleExpanded: geo.Curve = topCircleExpanded[0]
    bottomCircleExpanded: geo.Curve = bottomCircleExpanded[0]

    l = screw_line_extended
    tipCircle = topCircleExpanded.Duplicate()
    tipCircle.Translate(l.ToX - l.FromX, l.ToY - l.FromY, l.ToZ - l.FromZ)
    tipCircle.Transform(geo.Transform.Scale(l.To, .01))

    print(f"{type(topCircleExpanded)}{topCircleExpanded=} {type(bottomCircleExpanded)}{bottomCircleExpanded=}")
    screw_channel = geo.Brep.CreateFromLoft([topCircleExpanded, bottomCircleExpanded, tipCircle], geo.Point3d.Unset, geo.Point3d.Unset, geo.LoftType.Straight, False)
    print(f"{screw_channel=} len={len(screw_channel)}")
    screw_channels.append(screw_channel[0])
# ---------- end screwchannelformspy ----------
cap_holes = CapHoles(Brep=screwchannelformspy.screw_channels)
screw_channels = Brep(cap_holes)

# ----
# Box Mounting Tabs
attachment_tab_width = Panel("12.0")
screw_hole_d = Panel("5.0")
box_base_cl = BoxBaseCL(box=offset_box)
box_wall_thickness_2 = Number(box_wall_thickness)
explode_2 = Explode(Curve=box_base_cl, Recursive=True)  # -> Segments, Vertices
unit_x = UnitX(Factor=expr("-x", attachment_tab_width))
unit_x_2 = UnitX(Factor=expr("-x/2", attachment_tab_width))
panel_2 = Panel("""0.15
0.85""")
unit_z_5 = UnitZ(Factor=box_wall_thickness_2)

# ---- group: Left Edge
midpoint = Midpoint(Curve=explode_2.Segments)
deconstruct = Deconstruct(Point=midpoint)  # -> XComponent, YComponent, ZComponent
sort_list = SortList(Keys=deconstruct.XComponent, ValuesValuesA=explode_2.Segments)  # -> Keys, ValuesValuesA
list_item_2 = ListItem(List=sort_list.ValuesValuesA, Index="0", Wrap=True)

# ---- group: Side Edge
midpoint_2 = Midpoint(Curve=explode_2.Segments)
deconstruct_2 = Deconstruct(Point=midpoint_2)  # -> XComponent, YComponent, ZComponent
sort_list_2 = SortList(Keys=deconstruct_2.XComponent, ValuesValuesA=explode_2.Segments)  # -> Keys, ValuesValuesA
list_item_3 = ListItem(List=sort_list_2.ValuesValuesA, Index="1", Wrap=True)

# ----
box_edge = Line(list_item_2)
end_points = EndPoints(Curve=box_edge)  # -> Start, End
move_10 = Move(Geometry=box_edge, Motion=unit_x_2)  # -> Geometry, Transform
move_11 = Move(Geometry=end_points.Start, Motion=unit_x)  # -> Geometry, Transform
rectangle_3pt = Rectangle3Pt(PointA=end_points.Start, PointB=end_points.End, PointC=move_11.Geometry)  # -> Rectangle, Length
evaluate_curve = EvaluateCurve(Curve=move_10.Geometry, Parameter=panel_2)  # -> Point, Tangent, Angle
midpoint_3 = Midpoint(Curve=move_10.Geometry)
circle_7 = Circle(Plane=evaluate_curve.Point, Radius=expr("x/2", screw_hole_d))
length = Length(Curve=list_item_3)
boundary_surfaces = BoundarySurfaces(Edges=[rectangle_3pt.Rectangle, circle_7])
addition_3 = Addition(A=length, B=attachment_tab_width)
extrude_7 = Extrude(Base=boundary_surfaces, Direction=unit_z_5)
unit_x_3 = UnitX(Factor=addition_3)
move_12 = Move(Geometry=extrude_7, Motion=unit_x_3)  # -> Geometry, Transform
left_tab = Brep(extrude_7)
right_tab = Brep(move_12.Geometry)

# ---- group: Main Components
splitter_box_2 = Brep(splitter_box)
box_exterior = Brep(offset_box_cl)
screw_channels_2 = Brep(flatten(screw_channels))
knockouts_2 = Brep(knockouts)
screw_holes = Brep(extrude_5)
box_interior_2 = Brep(box_interior)
right_tab_2 = Brep(right_tab)
left_tab_2 = Brep(left_tab)
screw_pillars_4 = Brep(screw_pillars_3)

# ----
# Final Assembly
contact_nudge = Panel("0.1")
merge_2 = Merge(Data1=box_exterior, Data2=screw_channels_2)  # -> flatten(Result)
solid_union = SolidUnion(Breps=merge_2)
unit_z_6 = UnitZ(Factor="100")
unit_z_7 = UnitZ(Factor="150")
colour_picker_3 = ColourPicker(PickedColour=RGB(0, 84, 146))

# ---- group: Contact Nudge
negative_4 = Negative(Value=contact_nudge)
unit_z_8 = UnitZ(Factor=negative_4)
move_13 = Move(Geometry=screw_pillars_4, Motion=unit_z_8)  # -> Geometry, Transform

unit_z_9 = UnitZ(Factor=contact_nudge)
move_14 = Move(Geometry=screw_holes, Motion=unit_z_9)  # -> Geometry, Transform

# ----
merge_3 = Merge(Data1=knockouts_2, Data2=box_interior_2, Data3=move_14.Geometry)  # -> flatten(Result)
solid_difference_2 = SolidDifference(BrepsA=solid_union, BrepsB=merge_3)
solid_difference_3 = SolidDifference(BrepsA=solid_difference_2, BrepsB=splitter_box_2)
solid_intersection = SolidIntersection(BrepsA=solid_difference_2, BrepsB=splitter_box_2)
merge_4 = Merge(Data1=solid_difference_3, Data2=move_13.Geometry, Data3=left_tab_2, Data4=right_tab_2)  # -> flatten(Result)
solid_union_2 = SolidUnion(Breps=merge_4)
move_15 = Move(Geometry=solid_intersection, Motion=unit_z_7)  # -> Geometry, Transform
move_16 = Move(Geometry=solid_union_2, Motion=unit_z_6)  # -> Geometry, Transform
list_length = ListLength(List=move_16.Geometry)
list_length_2 = ListLength(List=move_15.Geometry)
panel_3 = Panel(list_length)
panel_4 = Panel(list_length_2)
box_base = Brep(move_16.Geometry)
box_top_2 = Brep(move_15.Geometry)
custom_preview_3 = CustomPreview(Geometry=[box_top_2, box_base], Material=colour_picker_3)

# ==== cluster MainPCBCL
wall_thickness = ClusterInput()
pcb_protect_above_mm = ClusterInput()
pcb_protect_below_mm = ClusterInput()
screw_d = ClusterInput()
knockout_breps = ClusterInput()
pcb_x = ClusterInput()
transform = ClusterInput()
pcb_y = ClusterInput()
screw_holes = ClusterInput()
pcb_protect_above_mm_2 = Number(pcb_protect_above_mm)
pcb_x_2 = Number(pcb_x)
pcb_y_2 = Number(pcb_y)
pcb_protect_below_mm_2 = Number(pcb_protect_below_mm)
screw_holes_2 = Point(screw_holes)
knockout_breps_2 = Brep(flatten(knockout_breps))
transform_2 = Transform(transform)
rectangle = Rectangle(Plane=PlaneXY(0, 0, 0), XSize=pcb_x_2, YSize=pcb_y_2, Radius=0)  # -> Rectangle, Length
unit_z = UnitZ(Factor=pcb_protect_below_mm_2)
list_length = ListLength(List=screw_holes_2)
unit_z_2 = UnitZ(Factor=pcb_protect_above_mm_2)
boundary_surfaces = BoundarySurfaces(Edges=rectangle.Rectangle)
plane = Plane(screw_holes_2)
reverse = Reverse(Vector=unit_z)
negative = Negative(Value=pcb_protect_below_mm_2)
knockout_breps_3 = Brep(knockout_breps_2)
extrude = Extrude(Base=boundary_surfaces, Direction=unit_z_2)
extrude_2 = Extrude(Base=boundary_surfaces, Direction=reverse)
screw_pillar = ScrewPillar(origin_plane=plane, screw_d=screw_d, wall_thickness=wall_thickness, pillar_height=negative)
unit_z_3 = UnitZ(Factor=pcb_protect_below_mm_2)
solid_union = SolidUnion(Breps=flatten([extrude, extrude_2]))
move = Move(Geometry=extrude, Motion=unit_z_3)  # -> Geometry, Transform
move_2 = Move(Geometry=solid_union, Motion=unit_z_3)  # -> Geometry, Transform
move_3 = Move(Geometry=knockout_breps_3, Motion=unit_z_3)  # -> Geometry, Transform
move_4 = Move(Geometry=screw_pillar, Motion=unit_z_3)  # -> Geometry, Transform
transform_3 = Transform(Geometry=move.Geometry, Transform=transform_2)
transform_4 = Transform(Geometry=move_3.Geometry, Transform=transform_2)
transform_5 = Transform(Geometry=move_2.Geometry, Transform=transform_2)
transform_6 = Transform(Geometry=move_4.Geometry, Transform=transform_2)
protectabovevol = ClusterOutput(transform_3)
geometry = ClusterOutput(transform_5)
geometry_2 = ClusterOutput(transform_4)
geometry_3 = ClusterOutput(transform_6)

# ==== cluster GNDAnchoredBoundingBoxCL
content = ClusterInput()
offset_mm = ClusterInput()
bounding_box = BoundingBox(Content=content, Plane=PlaneXY(0, 0, 0), UnionBox=True)  # -> Box, Box_2
offset_mm_2 = Number(offset_mm)
deconstruct_brep = DeconstructBrep(Brep=bounding_box.Box)  # -> Faces, Edges, Vertices
offset_surface = OffsetSurface(Surface=deconstruct_brep.Faces, Distance=offset_mm_2, Retrim=True)
area = Area(Geometry=offset_surface)  # -> Area, Centroid
deconstruct = Deconstruct(Point=area.Centroid)  # -> XComponent, YComponent, ZComponent
sort_list = SortList(Keys=deconstruct.ZComponent, ValuesValuesA=offset_surface)  # -> Keys, ValuesValuesA
cull_index = CullIndex(List=sort_list.ValuesValuesA, Indices="0", Wrap=True)
bounding_box_2 = BoundingBox(Content=cull_index, Plane=PlaneXY(0, 0, 0), UnionBox=True)  # -> Box, Box_2
box = ClusterOutput(bounding_box_2.Box)

# ==== cluster OffsetBoxCL
brep = ClusterInput()
offset_mm = ClusterInput()
deconstruct_brep = DeconstructBrep(Brep=brep)  # -> Faces, Edges, Vertices
offset_mm_2 = Number(offset_mm)
offset_surface = OffsetSurface(Surface=deconstruct_brep.Faces, Distance=offset_mm_2, Retrim=True)
bounding_box = BoundingBox(Content=offset_surface, Plane=PlaneXY(0, 0, 0), UnionBox=True)  # -> Box, Box_2
box = ClusterOutput(bounding_box.Box)

# ==== cluster BoxTopCL
box = ClusterInput()
deconstruct_brep = DeconstructBrep(Brep=box)  # -> Faces, Edges, Vertices
area = Area(Geometry=deconstruct_brep.Faces)  # -> Area, Centroid
deconstruct = Deconstruct(Point=area.Centroid)  # -> XComponent, YComponent, ZComponent
sort_list = SortList(Keys=deconstruct.ZComponent, ValuesValuesA=deconstruct_brep.Faces)  # -> Keys, ValuesValuesA
list_item = ListItem(List=sort_list.ValuesValuesA, Index="-1", Wrap=True)
i = ClusterOutput(list_item)

# ==== cluster BoxBaseCL
box = ClusterInput()
deconstruct_brep = DeconstructBrep(Brep=box)  # -> Faces, Edges, Vertices
area = Area(Geometry=deconstruct_brep.Faces)  # -> Area, Centroid
deconstruct = Deconstruct(Point=area.Centroid)  # -> XComponent, YComponent, ZComponent
sort_list = SortList(Keys=deconstruct.ZComponent, ValuesValuesA=deconstruct_brep.Faces)  # -> Keys, ValuesValuesA
list_item = ListItem(List=sort_list.ValuesValuesA, Index="0", Wrap=True)
i = ClusterOutput(list_item)

# ==== cluster ScrewPillar
origin_plane = ClusterInput()
wall_thickness = ClusterInput()
pillar_height = ClusterInput()
screw_d = ClusterInput()
wall_thickness_2 = Number(wall_thickness)
origin_plane_2 = Plane(origin_plane)
pillar_height_2 = Number(pillar_height)
screw_d_2 = Number(screw_d)
tl_pcb_screw = Circle(Plane=origin_plane_2, Radius=expr("x/2", screw_d_2))
flatten_tree = FlattenTree(Tree=tl_pcb_screw, Path="{0}")
offset_curve = OffsetCurve(Curve=flatten_tree, Distance=wall_thickness_2, Corners=1)
graft_tree = GraftTree(Tree=tl_pcb_screw, IncludeEmptyLists=True, IncludeNullItems=True)
panel = Panel(graft_tree)
panel_2 = Panel(offset_curve)
merge = Merge(Data1=graft_tree, Data2=offset_curve)
unit_z = UnitZ(Factor=pillar_height_2)
loft = Loft(Curves=merge, Options={Adjust=False, Closed=False, LoftEnds=0, LoftSimp=0, LoftType=0, Rebuild=10, Refit=0.01})  # -> flatten(Loft)
panel_3 = Panel(merge)
extrude = Extrude(Base=loft, Direction=unit_z)
pillar = ClusterOutput(extrude)
